# Grasshopper definition louvers.gh (Grasshopper 1.0.7)

curve = Curve(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)
raw01 = GetInteger(Slider(0, range=0..90), AtLeast=1, AtMost=1, Maximum=2147483647, Minimum=-2147483648, TreeAccess=False)
raw03 = GetInteger(Slider(0, range=0..90), AtLeast=1, AtMost=1, Maximum=2147483647, Minimum=-2147483648, TreeAccess=False)
raw02 = GetInteger(Slider(45, range=0..90), AtLeast=1, AtMost=1, Maximum=2147483647, Minimum=-2147483648, TreeAccess=False)
louvers_no = GetInteger(Slider(34, range=0..40), AtLeast=1, AtMost=1, Maximum=2147483647, Minimum=-2147483648, TreeAccess=False)
length = Length(Curve=curve)
unit_z = UnitZ(Factor=[Slider(4, range=0..100), Slider(8, range=0..100), Slider(12, range=0..100)])
panel = Panel(length)
move = Move(Geometry=curve, Motion=unit_z)  # -> Geometry, Transform
division = Division(A=panel, B=louvers_no)
perp_frames = PerpFrames(Curve=move.Geometry, Count=louvers_no, Align=True)  # -> Frames, Parameters
panel_2 = Panel(division)
construct_domain = ConstructDomain(DomainStart=expr("-x", Slider(0.2, range=0..4)), DomainEnd=expr("-x", Slider(4, range=0..4)))
division_2 = Division(A=panel_2, B="2")
construct_domain_2 = ConstructDomain(DomainStart=division_2, DomainEnd=expr("-x", division_2))
rectangle = Rectangle(Plane=perp_frames.Frames, XSize=construct_domain, YSize=construct_domain_2, Radius=0)  # -> Rectangle, Length
subtraction = Subtraction(A=louvers_no, B="1")
construct_domain_3 = ConstructDomain(DomainStart=Slider(1, range=0..30), DomainEnd=subtraction)
area = Area(Geometry=<missing>)  # -> Area, Centroid
sub_list = SubList(List=rectangle.Rectangle, Domain=construct_domain_3, Wrap=True)  # -> List, Index
area_2 = Area(Geometry=sub_list.List)  # -> Area, Centroid
merge = Merge(Data1=raw01, Data2=raw02, Data3=raw03)
list_length = ListLength(List=sub_list.List)
xy_plane = XYPlane(Origin=area_2.Centroid)
series = Series(Start=graft(merge), Step=Slider(16, range=0..30), Count=list_length)
rotate = Rotate(Geometry=sub_list.List, Angle=degrees(series), Plane=xy_plane)  # -> Geometry, Transform
surface = Surface(rotate.Geometry)
context_bake = ContextBake(Geometry=surface)
